# Grasshopper definition networking_assignment.gh (Grasshopper 1.0.7)

domain_box = DomainBox(Base=PlaneXY(0, 0, 0), X=Slider(7, range=0..10), Y=Slider(1, range=0..1), Z=Slider(1, range=0..1))
deconstruct_brep = DeconstructBrep(Brep=domain_box)  # -> Faces, Edges, Vertices
list_item = ListItem(List=deconstruct_brep.Edges, Index=Slider(5, range=0..10), Wrap=True)
list_item_2 = ListItem(List=deconstruct_brep.Edges, Index=Slider(7, range=0..10), Wrap=True)
point_on_curve = PointOnCurve(list_item_2, parameter=0.5)
point_on_curve_2 = PointOnCurve(list_item, parameter=0.5)
line = Line(StartPoint=point_on_curve, EndPoint=point_on_curve_2)
divide_curve = DivideCurve(Curve=line, Count=Slider(8, range=0..10), Kinks=False)  # -> Points, Tangents, Parameters
number_slider = Slider(0.11811, range=0..1)
cull_index = CullIndex(List=divide_curve.Points, Indices=[-1, 0], Wrap=True)
unit_z = UnitZ(Factor=1)
circle_cnr = CircleCNR(Center=cull_index, Normal=Vector(0, 0, 1), Radius=number_slider)
unit_x = UnitX(Factor=1)
amplitude = Amplitude(Vector=expr("-x", unit_z), Amplitude=Slider(0.35, range=0..1))
division = Division(A=number_slider, B=-1.75)
unit_x_2 = UnitX(Factor=1)
division_2 = Division(A=number_slider, B=1.75)
extrude = Extrude(Base=circle_cnr, Direction=amplitude)
amplitude_2 = Amplitude(Vector=unit_x, Amplitude=division)
amplitude_3 = Amplitude(Vector=unit_x_2, Amplitude=division_2)
cap_holes = CapHoles(Brep=extrude)
brep = Brep(domain_box)
circle_cnr_2 = CircleCNR(Center=cull_index, Normal=Vector(0, 0, 1), Radius=Slider(0.046, range=0..0.1))
move = Move(Geometry=circle_cnr_2, Motion=amplitude_3)  # -> Geometry, Transform
move_2 = Move(Geometry=circle_cnr_2, Motion=amplitude_2)  # -> Geometry, Transform
solid_difference = SolidDifference(BrepsA=brep, BrepsB=cap_holes)
unit_z_2 = UnitZ(Factor=1)
join_curves = JoinCurves(Curves=[move_2.Geometry, move.Geometry, circle_cnr_2], Preserve=False)
brep_2 = Brep(solid_difference)
amplitude_4 = Amplitude(Vector=unit_z_2, Amplitude=-2)
extrude_2 = Extrude(Base=join_curves, Direction=amplitude_4)
cap_holes_2 = CapHoles(Brep=extrude_2)
solid_difference_2 = SolidDifference(BrepsA=brep_2, BrepsB=cap_holes_2)
brep_3 = Brep(solid_difference_2)
